% Simulink data dictionary autocodePlantParams.sldd

truth_bus = Simulink.Bus()
  gyroBiasTrue_rps: double[3]
  accBiasTrue_mps2: double[3]

environment_bus = Simulink.Bus()
  gravityForceBdy_N: double[3]
  temp_K: double
  a_mps: double
  pressure_Pa: double
  rho_kgpm3: double
  onRail_b: boolean
  airspeed_mps: double[3]
  windBdy_mps: double[3]
  airW_rps: double[3]

fin_bus = Simulink.Bus()
  finMoment_Nm: double[3]
  finForce_N: double[3]
  aoa_deg: double
  liftSign_na: double
  airspeedFin_mps: double[3]

body_bus = Simulink.Bus()
  bodyMoment_Nm: double[3]
  bodyForce_N: double[3]
  aoa_deg: double

aero_bus = Simulink.Bus()
  aeroMoment_Nm: double[3]
  aeroForce_N: double[3]
  fin1_bus: Bus: fin_bus
  fin2_bus: Bus: fin_bus
  fin3_bus: Bus: fin_bus
  fin4_bus: Bus: fin_bus
  body_bus: Bus: body_bus

eom_bus = Simulink.Bus()
  posNed_m: double[3]
  q_na: double[4]
  velBdy_mps: double[3]
  wBdy_rps: double[3]
  accBdy_mps2: double[3]
  wDotBdy_rps2: double[3]

motor_bus = Simulink.Bus()
  thrust_N: double[3]

plant_bus = Simulink.Bus()
  enviroment_bus: Bus: environment_bus
  aero_bus: Bus: aero_bus
  eom_bus: Bus: eom_bus

noiseFiltered_bus = Simulink.Bus()
  accelFilt_mps2: double[3]
  gyroFilt_rps: double[3]

guidance_bus = Simulink.Bus()
  phiCmd_rad: double
  thetaCmd_rad: double
  psiCmd_rad: double

pidGains_bus = Simulink.Bus()
  P: double[3]
  I: double[3]
  D: double[3]
  N: double[3]

outerLoopAxis_bus = Simulink.Bus()
  rateCmd_rps: double
  rateLimited_b: boolean
  saturated_b: boolean

outerLoop_bus = Simulink.Bus()
  pitchOuterLoop_bus: Bus: outerLoopAxis_bus
  yawOuterLoop_bus: Bus: outerLoopAxis_bus
  rollOuterLoop_bus: Bus: outerLoopAxis_bus

innerLoopAxis_bus = Simulink.Bus()
  control_deg: double
  controlMoment_Nm: double
  rateLimted_b: boolean
  saturated_b: boolean

innerLoop_bus = Simulink.Bus()
  pitchInnerLoop_bus: Bus: innerLoopAxis_bus
  yawInnerLoop_bus: Bus: innerLoopAxis_bus
  rollInnerLoop_bus: Bus: innerLoopAxis_bus

controller_bus = Simulink.Bus()
  outerLoop_bus: Bus: outerLoop_bus
  innerLoop_bus: Bus: innerLoop_bus
  control_deg: double[4]

simOut_bus = Simulink.Bus()
  navigation_bus: Bus: navigation_bus
  controller_bus: Bus: controller_bus
  plant_bus: Bus: plant_bus
  sensor_bus: Bus: sensor_bus

complementaryFilter_bus = Simulink.Bus()
  qEst_na: double[4]
  velEstNed_mps: double[3]
  posEst_m: double[3]

deadReckoning_bus = Simulink.Bus()
  qEst_na: double[4]
  posEst_m: double[3]
  velEstNed_mps: double[3]

sensorEst_bus = Simulink.Bus()
  accBdyEst_mps2: double[3]
  fBdyEst_mps2: double[3]
  wBdyEst_rps: double[3]
  altitudeEst_m: double
  posEst_m: double[3]

bias_bus = Simulink.Bus()
  accelBias_mps2: double[3]
  gyroBias_rps: double[3]
  altitudeBias_m: double
  llaBias_na: double[3]

filter_bus = Simulink.Bus()
  eulerAnglesEst_rad: double[3]
  qEst_na: double[4]
  velEstNed_mps: double[3]
  posEst_m: double[3]
  accelFilt_mps2: double[3]
  gyroFilt_rps: double[3]
  accelBias_mps2: double[3]
  gyroBias_rps: double[3]
  altitudeBias_m: double
  llaBias_na: double[3]

navigation_bus = Simulink.Bus()
  flightMode_enum: Enum: flightMode
  qEst_na: double[4]
  phiEst_rad: double
  thetaEst_rad: double
  psiEst_rad: double
  pEst_rps: double
  qEst_rps: double
  rEst_rps: double
  xAccEst_mps2: double
  yAccEst_mps2: double
  zAccEst_mps2: double
  accelBias_mps2: double[3]
  gyroBias_rps: double[3]
  altitudeBias_m: double
  llaBias_na: double[3]
  dynPressureEst_Pa: double
  xVelEstNed_mps: double
  yVelEstNed_mps: double
  zVelEstNed_mps: double
  xPosEst_m: double
  yPosEst_m: double
  zPosEst_m: double

sensor_bus = Simulink.Bus()
  truth_bus: Bus: truth_bus
  fBdyMeas_mps2: double[3]
  wBdyMeas_rps: double[3]
  magBdyMeas_nT: double[3]
  baroMeas_Pa: double
  velNedMeas_mps: double[3]
  gpsLLA_na: double[3]
  gpsFix_b: boolean

cal_autocodePlantParams_simParams = Simulink.Bus(DataScope="Exported", HeaderFile="autocodePlantParams_calibration_types.h")
  dt_s: double

simParams = Simulink.Parameter(struct(dt_s=0.01), StorageClass="ExportToFile", HeaderFile="autocodePlantParams_calibration.h", DefinitionFile="autocodePlantParams_calibration.c", DataType="Bus: cal_autocodePlantParams_simParams")

cal_autocodePlantParams_envParams = Simulink.Bus(DataScope="Exported", HeaderFile="autocodePlantParams_calibration_types.h")
  gravityNed_mps2: double[1 3]
  lon_deg: double
  lat_deg: double
  groundAlt_m: double
  date_y: double

envParams = Simulink.Parameter(struct(gravityNed_mps2=[0 0 9.81], lon_deg=-87.67671, lat_deg=42.05694, groundAlt_m=182, date_y=2026.666), StorageClass="ExportToFile", HeaderFile="autocodePlantParams_calibration.h", DefinitionFile="autocodePlantParams_calibration.c", DataType="Bus: cal_autocodePlantParams_envParams")

cal_autocodePlantParams_aeroParams = Simulink.Bus(DataScope="Exported", HeaderFile="autocodePlantParams_calibration_types.h")
  aeroFileName: uint8[1 14]
  finStaticScale_na: double
  finControlScale_na: double
  finStaticInputScale_na: double
  finControlInputScale_na: double
  bodyScale_na: double
  CpBaseShift_m: double
  finCP1_m: double[3 1]
  finCP2_m: double[3 1]
  finCP3_m: double[3 1]
  finCP4_m: double[3 1]
  finAngles1_rad: double[1 3]
  finAngles2_rad: double[1 3]
  finAngles3_rad: double[1 3]
  finAngles4_rad: double[1 3]
  machBreakpoints_na: double[1 10]
  aoaBreakpoints_deg: double[1 3]
  controlBreakpoints_deg: double[1 5]
  CpBase_m: double[10 3]
  CaBase_na: double[10 3]
  CnBase_na: double[10 3]
  CnFin_na: double[10 3 5]
  CaFin_na: double[10 3 5]

aeroParams = Simulink.Parameter(struct(
  aeroFileName=uint8([97 101 114 111 84 97 98 108 101 115 46 109 97 116]),
  finStaticScale_na=1,
  finControlScale_na=1,
  finStaticInputScale_na=1,
  finControlInputScale_na=1,
  bodyScale_na=1,
  CpBaseShift_m=0,
  finCP1_m=[2.667005; 0.1270003; 0],
  finCP2_m=[2.667005; 0; 0.1270003],
  finCP3_m=[2.667005; -0.1270003; 0],
  finCP4_m=[2.667005; 0; -0.1270003],
  finAngles1_rad=[0 0 0],
  finAngles2_rad=[1.570796 0 0],
  finAngles3_rad=[3.141593 0 0],
  finAngles4_rad=[4.712389 0 0],
  machBreakpoints_na=[0.1 0.2 0.3 0.4 0.5 0.6 0.7 0.8 0.9 1],
  aoaBreakpoints_deg=[0 2 4],
  controlBreakpoints_deg=[-4 -2 0 2 4],
  CpBase_m=[0.4291085 0.6731775 0.8208534
   0.4291085 0.6731775 0.8208534
   0.4291085 0.6731775 0.8208534
   0.4291085 0.6731775 0.8208534
   0.4291085 0.6731775 0.8208534
   0.4291085 0.6731775 0.8208534
   0.4291085 0.6731775 0.8208534
   0.4291085 0.6731775 0.8208534
   0.4291085 0.6731775 0.8208534
   0.3272035 0.6183642 0.786919],
  CaBase_na=[0.301 0.301 0.302
   0.3 0.301 0.302
   0.3 0.3 0.301
   0.299 0.3 0.301
   0.299 0.3 0.301
   0.299 0.299 0.3
   0.298 0.299 0.3
   0.298 0.298 0.3
   0.298 0.298 0.299
   0.415 0.415 0.417],
  CnBase_na=[0 0.109 0.27
   0 0.109 0.27
   0 0.109 0.27
   0 0.109 0.27
   0 0.109 0.27
   0 0.109 0.27
   0 0.109 0.27
   0 0.109 0.27
   0 0.109 0.27
   0 0.101 0.255],
  CnFin_na=reshape([-0.0385 -0.0385 -0.0385 -0.0385 -0.0385 -0.0385 -0.0385 -0.0385 -0.0385 -0.0328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], 10, 3, 5),
  CaFin_na=reshape([0.03635 0.03685 0.0369 0.03845 0.03905 0.03965 0.0423 0.044 0.04625 0.04345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], 10, 3, 5)), StorageClass="ExportToFile", HeaderFile="autocodePlantParams_calibration.h", DefinitionFile="autocodePlantParams_calibration.c", DataType="Bus: cal_autocodePlantParams_aeroParams")

cal_autocodePlantParams_vehicleParams = Simulink.Bus(DataScope="Exported", HeaderFile="autocodePlantParams_calibration_types.h")
  length_m: double
  mass_kg: double
  area_m2: double
  cg_m: double
  inertia_kgm2: double[3 3]

vehicleParams = Simulink.Parameter(struct(
  length_m=2.75,
  mass_kg=17.5,
  area_m2=0.018,
  cg_m=1.811786,
  inertia_kgm2=[0.053 0 0; 0 8.41 0; 0 0 8.41]), StorageClass="ExportToFile", HeaderFile="autocodePlantParams_calibration.h", DefinitionFile="autocodePlantParams_calibration.c", DataType="Bus: cal_autocodePlantParams_vehicleParams")

cal_autocodePlantParams_sensorParams = Simulink.Bus(DataScope="Exported", HeaderFile="autocodePlantParams_calibration_types.h")
  imuPosBdy_m: double[1 3]
  accMarkovGain_na: double
  accTurnOnBias_mps2: double[1 3]
  accSigmaBias_mps2: double[1 3]
  accPSDGM: double[1 3]
  accPSDWhite: double[1 3]
  accScaleCoupling_na: double[3 3]
  accSampleTime_s: double
  gyroMarkovGain_na: double
  gyroSigmaBiasTurnOn_rps: double[1 3]
  gyroSigmaBias_rps: double[1 3]
  gyroTurnOnBias_rps: double[1 3]
  gyroPSDWhite: double[1 3]
  gyroPSDGM: double[1 3]
  gyroG: double[3 3]
  gyroScaleCoupling_na: double[3 3]
  gyroSampleTime_s: double
  magBiasHIBdy_nT: double[1 3]
  magSampleTime_s: double
  magPSDWhite: double[1 3]
  baroBiasTurnOn_Pa: double
  baroMarkovGain_na: double
  baroSampleTime_s: double
  magSI: double[3 3]
  baroPSDWhite: double
  baroPSDGM: double
  gpsSampleTime_s: double
  gpsDelay_na: double
  gpsOutageSampleTime_s: double
  gpsOutageProbability_pct: double

sensorParams = Simulink.Parameter(struct(
  imuPosBdy_m=[0 0 0],
  accMarkovGain_na=0.99995,
  accTurnOnBias_mps2=[-0.01056035 -0.01056035 -0.01056035],
  accSigmaBias_mps2=[0.001962 0.001962 0.001962],
  accPSDGM=[3.84954e-08 3.84954e-08 3.84954e-08],
  accPSDWhite=[5.413280625e-7 5.413280625e-7 5.413280625e-7],
  accScaleCoupling_na=[1 0 0; 0 1 0; 0 0 1],
  accSampleTime_s=0.01,
  gyroMarkovGain_na=0.99995,
  gyroSigmaBiasTurnOn_rps=[0.009 0.009 0.009],
  gyroSigmaBias_rps=[0.0004848 0.0004848 0.0004848],
  gyroTurnOnBias_rps=[0.007805089 0.007805089 0.007805089],
  gyroPSDWhite=[3.730156e-11 3.730156e-11 3.730156e-11],
  gyroPSDGM=[2.350369e-09 2.350369e-09 2.350369e-09],
  gyroG=[8.89716e-05 0 0; 0 8.89716e-05 0; 0 0 8.89716e-05],
  gyroScaleCoupling_na=[1 0 0; 0 1 0; 0 0 1],
  gyroSampleTime_s=0.01,
  magBiasHIBdy_nT=[1200 -800 500],
  magSampleTime_s=0.01,
  magPSDWhite=[196 196 196],
  baroBiasTurnOn_Pa=40,
  baroMarkovGain_na=0.99998,
  baroSampleTime_s=0.01,
  magSI=[1.08 0.05 -0.03; 0.04 0.93 0.02; -0.03 0.02 1.05],
  baroPSDWhite=0.0004,
  baroPSDGM=0.1440014,
  gpsSampleTime_s=0.1,
  gpsDelay_na=15,
  gpsOutageSampleTime_s=1,
  gpsOutageProbability_pct=0.1), StorageClass="ExportToFile", HeaderFile="autocodePlantParams_calibration.h", DefinitionFile="autocodePlantParams_calibration.c", DataType="Bus: cal_autocodePlantParams_sensorParams")

cal_autocodePlantParams_windParams = Simulink.Bus(DataScope="Exported", HeaderFile="autocodePlantParams_calibration_types.h")
  useWindShear_b: boolean
  useWindTurbulence_b: boolean
  constantNed_mps: double[3 1]
  lowAltWindSpeed_mps: double
  lowAltWindDir_deg: double

windParams = Simulink.Parameter(struct(
  useWindShear_b=false,
  useWindTurbulence_b=false,
  constantNed_mps=[5; 0; 0],
  lowAltWindSpeed_mps=5,
  lowAltWindDir_deg=180), StorageClass="ExportToFile", HeaderFile="autocodePlantParams_calibration.h", DefinitionFile="autocodePlantParams_calibration.c", DataType="Bus: cal_autocodePlantParams_windParams")

cal_autocodePlantParams_icParams = Simulink.Bus(DataScope="Exported", HeaderFile="autocodePlantParams_calibration_types.h")
  velBdy_mps: double[1 3]
  rateBdy_rps: double[1 3]
  posNed_m: double[1 3]
  eulIC_rad: double[1 3]
  eul_rad: double[1 3]

icParams = Simulink.Parameter(struct(
  velBdy_mps=[0 0 0],
  rateBdy_rps=[0 0 0],
  posNed_m=[0 0 0],
  eulIC_rad=[1 0.1 0],
  eul_rad=[-2.141593 1.470796 3.141593]), StorageClass="ExportToFile", HeaderFile="autocodePlantParams_calibration.h", DefinitionFile="autocodePlantParams_calibration.c", DataType="Bus: cal_autocodePlantParams_icParams")

cal_autocodePlantParams_motorParams = Simulink.Bus(DataScope="Exported", HeaderFile="autocodePlantParams_calibration_types.h")
  thrustDataFile: uint8[1 19]
  startUpDelay: double
  thrustData: double[26 2]
  time: double[26 1]
  thrustScaling_na: double
  thrust: double[26 1]

motorParams = Simulink.Parameter(struct(
  thrustDataFile=uint8([65 101 114 111 84 101 99 104 95 77 49 51 49 53 87 46 99 115 118]),
  startUpDelay=20,
  thrustData=[0.116 1728.683
   0.349 1673.336
   0.582 1686.81
   0.816 1696.068
   1.049 1663.167
   1.282 1631.243
   1.516 1620.471
   1.749 1619.702
   1.982 1621.042
   2.216 1615.32
   2.449 1567.089
   2.682 1493.722
   2.916 1420.079
   3.149 1358.66
   3.382 1292.507
   3.616 1224.806
   3.849 1171.995
   4.082 928.809
   4.316 577.949
   4.549 395.445
   4.782 314.006
   5.016 228.273
   5.249 159.803
   5.482 118.348
   5.716 109.782
   5.949 0],
  time=[0.116; 0.349; 0.582; 0.816; 1.049; 1.282; 1.516; 1.749; 1.982; 2.216; 2.449; 2.682; 2.916; 3.149; 3.382; 3.616; 3.849; 4.082; 4.316; 4.549; 4.782; 5.016; 5.249; 5.482; 5.716; 5.949],
  thrustScaling_na=1,
  thrust=[1728.683; 1673.336; 1686.81; 1696.068; 1663.167; 1631.243; 1620.471; 1619.702; 1621.042; 1615.32; 1567.089; 1493.722; 1420.079; 1358.66; 1292.507; 1224.806; 1171.995; 928.809; 577.949; 395.445; 314.006; 228.273; 159.803; 118.348; 109.782; 0]), StorageClass="ExportToFile", HeaderFile="autocodePlantParams_calibration.h", DefinitionFile="autocodePlantParams_calibration.c", DataType="Bus: cal_autocodePlantParams_motorParams")