% Simulink data dictionary controllerParams.sldd

cal_controllerParams_guidanceParams = Simulink.Bus(DataScope="Exported", HeaderFile="controllerParams_calibration_types.h")
  phiCmd_rad: double
  thetaCmd_rad: double
  psiCmd_rad: double

guidanceParams = Simulink.Parameter(struct(phiCmd_rad=0, thetaCmd_rad=0, psiCmd_rad=0), StorageClass="ExportToFile", HeaderFile="controllerParams_calibration.h", DefinitionFile="controllerParams_calibration.c", DataType="Bus: cal_controllerParams_guidanceParams")

cal_controllerParams_innerLoopParams = Simulink.Bus(DataScope="Exported", HeaderFile="controllerParams_calibration_types.h")
  upRateLimitPitchYaw_dps: double
  loRateLimitPitchYaw_dps: double
  upLimitPitchYaw_deg: double
  loLimitPitchYaw_deg: double
  upRateLimitRoll_dps: double
  loRateLimitRoll_dps: double
  upLimitRoll_deg: double
  loLimitRoll_deg: double
  fbkGainBreakpoints_Pa: double[1 3]
  fbkGainPitchYawP_na: double[1 3]
  fbkGainPitchYawI_na: double[1 3]
  fbkGainPitchYawD_na: double[1 3]
  fbkGainPitchYawN_na: double[1 3]
  fbkGainRollP_na: double[1 3]
  fbkGainRollI_na: double[1 3]
  fbkGainRollD_na: double[1 3]
  fbkGainRollN_na: double[1 3]

innerLoopParams = Simulink.Parameter(struct(
  upRateLimitPitchYaw_dps=180,
  loRateLimitPitchYaw_dps=-180,
  upLimitPitchYaw_deg=45,
  loLimitPitchYaw_deg=-45,
  upRateLimitRoll_dps=90,
  loRateLimitRoll_dps=-90,
  upLimitRoll_deg=5,
  loLimitRoll_deg=-5,
  fbkGainBreakpoints_Pa=[0 30000 75000],
  fbkGainPitchYawP_na=[300 250 200],
  fbkGainPitchYawI_na=[2000 3000 4000],
  fbkGainPitchYawD_na=[0 0 0],
  fbkGainPitchYawN_na=[1 1 1],
  fbkGainRollP_na=[2.75 2.625 2.5],
  fbkGainRollI_na=[20 12 10],
  fbkGainRollD_na=[0 0 0],
  fbkGainRollN_na=[1 1 1]), StorageClass="ExportToFile", HeaderFile="controllerParams_calibration.h", DefinitionFile="controllerParams_calibration.c", DataType="Bus: cal_controllerParams_innerLoopParams")

cal_controllerParams_outerLoopParams = Simulink.Bus(DataScope="Exported", HeaderFile="controllerParams_calibration_types.h")
  upRateLimitPitchYawRate_rps2: double
  loRateLimitPitchYawRate_rps2: double
  upLimitPitchYawRate_rps: double
  loLimitPitchYawRate_rps: double
  pitchYawGains: double[1 4]
  upRateLimitRollRate_rps2: double
  loRateLimitRollRate_rps2: double
  upLimitRollRate_rps: double
  loLimitRollRate_rps: double
  rollGains: double[1 4]

outerLoopParams = Simulink.Parameter(struct(
  upRateLimitPitchYawRate_rps2=0.5,
  loRateLimitPitchYawRate_rps2=-0.5,
  upLimitPitchYawRate_rps=0.4,
  loLimitPitchYawRate_rps=-0.4,
  pitchYawGains=[2 1 0 1],
  upRateLimitRollRate_rps2=5,
  loRateLimitRollRate_rps2=-5,
  upLimitRollRate_rps=2,
  loLimitRollRate_rps=-2,
  rollGains=[1 2 0 100]), StorageClass="ExportToFile", HeaderFile="controllerParams_calibration.h", DefinitionFile="controllerParams_calibration.c", DataType="Bus: cal_controllerParams_outerLoopParams")