% Simulink data dictionary navParams.sldd

navControl = Simulink.Parameter(struct(useNav_b=true, dt_s=0.01, q0_na=[0.670044 0.03353015 0.7406369 0.03706274]))

navStates = Simulink.Parameter(struct(
  debounce_s=0.1,
  boostThreshold_mps2=50,
  coastThresholdxAcc_mps2=0,
  coastThresholdAlt_m=200,
  controlTresholdPitchYaw_rad=0.3,
  controlTresholdPitchYawRate_rps=1))