% Simulink data dictionary plantParams.sldd

vehicleParams = Simulink.Parameter(struct(
  length_m=2.75,
  mass_kg=17.5,
  area_m2=0.018,
  cg_m=1.811786,
  inertia_kgm2=[0.053 0 0; 0 8.41 0; 0 0 8.41]), StorageClass="ExportToFile", HeaderFile="autocodePlantParams_calibration.h", DefinitionFile="autocodePlantParams_calibration.c")

simParams = Simulink.Parameter(struct(dt_s=0.01), StorageClass="ExportToFile", HeaderFile="autocodePlantParams_calibration.h", DefinitionFile="autocodePlantParams_calibration.c")
icParams = Simulink.Parameter(struct(velBdy_mps=[0 0 0], rateBdy_rps=[0 0 0], posNed_m=[0 0 0], eulIC_rad=[0 0 0], eul_rad=[0 1.570796 -0]), StorageClass="ExportToFile", HeaderFile="autocodePlantParams_calibration.h", DefinitionFile="autocodePlantParams_calibration.c")
envParams = Simulink.Parameter(struct(gravityNed_mps2=[0 0 9.81], lon_deg=-87.67671, lat_deg=42.05694, groundAlt_m=182, date_y=2026.666), StorageClass="ExportToFile", HeaderFile="autocodePlantParams_calibration.h", DefinitionFile="autocodePlantParams_calibration.c")

motorParams = Simulink.Parameter(struct(
  thrustDataFile="AeroTech_M1315W.csv",
  startUpDelay=20,
  thrustData=[0.116 1728.683
   0.349 1673.336
   0.582 1686.81
   0.816 1696.068
   1.049 1663.167
   1.282 1631.243
   1.516 1620.471
   1.749 1619.702
   1.982 1621.042
   2.216 1615.32
   2.449 1567.089
   2.682 1493.722
   2.916 1420.079
   3.149 1358.66
   3.382 1292.507
   3.616 1224.806
   3.849 1171.995
   4.082 928.809
   4.316 577.949
   4.549 395.445
   4.782 314.006
   5.016 228.273
   5.249 159.803
   5.482 118.348
   5.716 109.782
   5.949 0],
  time=[0.116; 0.349; 0.582; 0.816; 1.049; 1.282; 1.516; 1.749; 1.982; 2.216; 2.449; 2.682; 2.916; 3.149; 3.382; 3.616; 3.849; 4.082; 4.316; 4.549; 4.782; 5.016; 5.249; 5.482; 5.716; 5.949],
  thrustScaling_na=1,
  thrust=[1728.683; 1673.336; 1686.81; 1696.068; 1663.167; 1631.243; 1620.471; 1619.702; 1621.042; 1615.32; 1567.089; 1493.722; 1420.079; 1358.66; 1292.507; 1224.806; 1171.995; 928.809; 577.949; 395.445; 314.006; 228.273; 159.803; 118.348; 109.782; 0]), StorageClass="ExportToFile", HeaderFile="autocodePlantParams_calibration.h", DefinitionFile="autocodePlantParams_calibration.c")

aeroParams = Simulink.Parameter(struct(
  aeroFileName="aeroTables.mat",
  finStaticScale_na=1,
  finControlScale_na=1,
  finStaticInputScale_na=1,
  finControlInputScale_na=1,
  bodyScale_na=1,
  CpBaseShift_m=0,
  finCP1_m=[2.667005; 0.1270003; 0],
  finCP2_m=[2.667005; 0; 0.1270003],
  finCP3_m=[2.667005; -0.1270003; 0],
  finCP4_m=[2.667005; 0; -0.1270003],
  finAngles1_rad=[0 0 0],
  finAngles2_rad=[1.570796 0 0],
  finAngles3_rad=[3.141593 0 0],
  finAngles4_rad=[4.712389 0 0],
  machBreakpoints_na=[0.1 0.2 0.3 0.4 0.5 0.6 0.7 0.8 0.9 1],
  aoaBreakpoints_deg=[0 2 4],
  controlBreakpoints_deg=[-4 -2 0 2 4],
  CpBase_m=[0.4291085 0.6731775 0.8208534
   0.4291085 0.6731775 0.8208534
   0.4291085 0.6731775 0.8208534
   0.4291085 0.6731775 0.8208534
   0.4291085 0.6731775 0.8208534
   0.4291085 0.6731775 0.8208534
   0.4291085 0.6731775 0.8208534
   0.4291085 0.6731775 0.8208534
   0.4291085 0.6731775 0.8208534
   0.3272035 0.6183642 0.786919],
  CaBase_na=[0.301 0.301 0.302
   0.3 0.301 0.302
   0.3 0.3 0.301
   0.299 0.3 0.301
   0.299 0.3 0.301
   0.299 0.299 0.3
   0.298 0.299 0.3
   0.298 0.298 0.3
   0.298 0.298 0.299
   0.415 0.415 0.417],
  CnBase_na=[0 0.109 0.27
   0 0.109 0.27
   0 0.109 0.27
   0 0.109 0.27
   0 0.109 0.27
   0 0.109 0.27
   0 0.109 0.27
   0 0.109 0.27
   0 0.109 0.27
   0 0.101 0.255],
  CnFin_na=reshape([-0.0385 -0.0385 -0.0385 -0.0385 -0.0385 -0.0385 -0.0385 -0.0385 -0.0385 -0.0328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], 10, 3, 5),
  CaFin_na=reshape([0.03635 0.03685 0.0369 0.03845 0.03905 0.03965 0.0423 0.044 0.04625 0.04345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], 10, 3, 5)), StorageClass="ExportToFile", HeaderFile="autocodePlantParams_calibration.h", DefinitionFile="autocodePlantParams_calibration.c")

sensorParams = Simulink.Parameter(struct(
  imuPosBdy_m=[0 0 0],
  accMarkovGain_na=0.99995,
  accTurnOnBias_mps2=[-0.01056035 -0.01056035 -0.01056035],
  accSigmaBias_mps2=[0.001962 0.001962 0.001962],
  accPSDGM=[3.84954e-08 3.84954e-08 3.84954e-08],
  accPSDWhite=[5.413280625e-7 5.413280625e-7 5.413280625e-7],
  accScaleCoupling_na=[1 0 0; 0 1 0; 0 0 1],
  accSampleTime_s=0.01,
  gyroMarkovGain_na=0.99995,
  gyroSigmaBiasTurnOn_rps=[0.009 0.009 0.009],
  gyroSigmaBias_rps=[0.0004848 0.0004848 0.0004848],
  gyroTurnOnBias_rps=[0.007805089 0.007805089 0.007805089],
  gyroPSDWhite=[3.730156e-11 3.730156e-11 3.730156e-11],
  gyroPSDGM=[2.350369e-09 2.350369e-09 2.350369e-09],
  gyroG=[8.89716e-05 0 0; 0 8.89716e-05 0; 0 0 8.89716e-05],
  gyroScaleCoupling_na=[1 0 0; 0 1 0; 0 0 1],
  gyroSampleTime_s=0.01,
  magBiasHIBdy_nT=[1200 -800 500],
  magSampleTime_s=0.01,
  magPSDWhite=[196 196 196],
  baroBiasTurnOn_Pa=40,
  baroMarkovGain_na=0.99998,
  baroSampleTime_s=0.01,
  magSI=[1.08 0.05 -0.03; 0.04 0.93 0.02; -0.03 0.02 1.05],
  baroPSDWhite=0.0004,
  baroPSDGM=0.1440014,
  gpsSampleTime_s=0.1,
  gpsDelay_na=15,
  gpsOutageSampleTime_s=1,
  gpsOutageProbability_pct=0.1), StorageClass="ExportToFile", HeaderFile="autocodePlantParams_calibration.h", DefinitionFile="autocodePlantParams_calibration.c")

windParams = Simulink.Parameter(struct(
  useWindShear_b=false,
  useWindTurbulence_b=false,
  constantNed_mps=[0; 0; 0],
  lowAltWindSpeed_mps=0,
  lowAltWindDir_deg=180), StorageClass="ExportToFile", HeaderFile="autocodePlantParams_calibration.h", DefinitionFile="autocodePlantParams_calibration.c")